# Grasshopper definition bus-hab-opt-GENERAL_v2.gh (Grasshopper 1.0.8)

geo = Geometry([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])
geo_2 = Geometry([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])
geo_3 = Geometry(Tree({0;0;0}: [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], {0;1;0}: [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], {0;2;0}: [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], {0;3;0}: [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], {0;4;0}: [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], {0;5;0}: [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]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))
geo_4 = Geometry([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])
geo_5 = Geometry([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])
pt = Point(Point(0, 0, 0))
pt_2 = Point(Point(0, 0, 0))
pt_3 = Point(Point(0, 0, 0))
vec = VectorXYZ(XComponent=0, YComponent=Slider(360, range=0..1000), ZComponent=0)  # -> Vector, Length
vec_2 = VectorXYZ(XComponent=0, YComponent=Slider(120, range=0..1000), ZComponent=0)  # -> Vector, Length
vec_3 = VectorXYZ(XComponent=0, YComponent=Slider(132, range=0..1000), ZComponent=0)  # -> Vector, Length
move = Move(Geometry=pt, Motion=vec.Vector)  # -> Geometry, Transform
move_2 = Move(Geometry=pt_2, Motion=vec_2.Vector)  # -> Geometry, Transform
move_3 = Move(Geometry=pt_3, Motion=vec_3.Vector)  # -> Geometry, Transform
pt_4 = Point(Point(0, 0, 0))
pt_5 = Point(move.Geometry)
pt_6 = Point(move_2.Geometry)
pt_7 = Point(move_3.Geometry)
neg = Negative(Value=Slider(48, range=0..1000))
neg_2 = Negative(Value=Slider(18, range=0..1000))
neg_3 = Negative(Value=Slider(12, range=0..1000))
neg_4 = Negative(Value=Slider(12, range=0..1000))
vec_4 = VectorXYZ(XComponent=neg, YComponent=0, ZComponent=Slider(120, range=0..1000))  # -> Vector, Length
vec_5 = VectorXYZ(XComponent=neg_2, YComponent=0, ZComponent=Slider(12, range=0..1000))  # -> Vector, Length
vec_6 = VectorXYZ(XComponent=neg_3, YComponent=0, ZComponent=Slider(100, range=0..1000))  # -> Vector, Length
vec_7 = VectorXYZ(XComponent=neg_4, YComponent=0, ZComponent=Slider(90, range=0..1000))  # -> Vector, Length
move_4 = Move(Geometry=pt_4, Motion=vec_4.Vector)  # -> Geometry, Transform
move_5 = Move(Geometry=pt_5, Motion=vec_5.Vector)  # -> Geometry, Transform
move_6 = Move(Geometry=pt_6, Motion=vec_6.Vector)  # -> Geometry, Transform
move_7 = Move(Geometry=pt_7, Motion=vec_7.Vector)  # -> Geometry, Transform
pt_8 = Point(move_4.Geometry)
pt_9 = Point(move_5.Geometry)
pt_10 = Point(move_6.Geometry)
pt_11 = Point(move_7.Geometry)
vec_8 = VectorXYZ(XComponent=Slider(60, range=0..1000), YComponent=0, ZComponent=Slider(24, range=0..100))  # -> Vector, Length
vec_9 = VectorXYZ(XComponent=Slider(42, range=0..1000), YComponent=0, ZComponent=Slider(12, range=0..100))  # -> Vector, Length
vec_10 = VectorXYZ(XComponent=Slider(36, range=0..1000), YComponent=0, ZComponent=Slider(12, range=0..100))  # -> Vector, Length
vec_11 = VectorXYZ(XComponent=Slider(36, range=0..1000), YComponent=0, ZComponent=Slider(12, range=0..100))  # -> Vector, Length
move_8 = Move(Geometry=pt_8, Motion=vec_8.Vector)  # -> Geometry, Transform
move_9 = Move(Geometry=pt_9, Motion=vec_9.Vector)  # -> Geometry, Transform
move_10 = Move(Geometry=pt_10, Motion=vec_10.Vector)  # -> Geometry, Transform
move_11 = Move(Geometry=pt_11, Motion=vec_11.Vector)  # -> Geometry, Transform
pt_12 = Point(move_8.Geometry)
pt_13 = Point(move_9.Geometry)
pt_14 = Point(move_10.Geometry)
pt_15 = Point(move_11.Geometry)
neg_5 = Negative(Value=Slider(12, range=0..100))
neg_6 = Negative(Value=Slider(36, range=0..100))
neg_7 = Negative(Value=Slider(6, range=0..100))
neg_8 = Negative(Value=Slider(6, range=0..100))
vec_12 = VectorXYZ(XComponent=Slider(24, range=0..100), YComponent=0, ZComponent=neg_5)  # -> Vector, Length
vec_13 = VectorXYZ(XComponent=Slider(4, range=0..100), YComponent=0, ZComponent=neg_6)  # -> Vector, Length
vec_14 = VectorXYZ(XComponent=Slider(24, range=0..100), YComponent=0, ZComponent=neg_7)  # -> Vector, Length
vec_15 = VectorXYZ(XComponent=Slider(24, range=0..100), YComponent=0, ZComponent=neg_8)  # -> Vector, Length
move_12 = Move(Geometry=pt_12, Motion=vec_12.Vector)  # -> Geometry, Transform
move_13 = Move(Geometry=pt_13, Motion=vec_13.Vector)  # -> Geometry, Transform
move_14 = Move(Geometry=pt_14, Motion=vec_14.Vector)  # -> Geometry, Transform
move_15 = Move(Geometry=pt_15, Motion=vec_15.Vector)  # -> Geometry, Transform
pt_16 = Point(move_12.Geometry)
pt_17 = Point(move_13.Geometry)
pt_18 = Point(move_14.Geometry)
pt_19 = Point(move_15.Geometry)
merge = Merge(Data1=pt_4, Data2=pt_8, Data3=pt_12, Data4=pt_16)
merge_2 = Merge(Data1=pt_5, Data2=pt_9, Data3=pt_13, Data4=pt_17)
merge_3 = Merge(Data1=pt_6, Data2=pt_10, Data3=pt_14, Data4=pt_18)
merge_4 = Merge(Data1=pt_7, Data2=pt_11, Data3=pt_15, Data4=pt_19)
pline = PolyLine(Vertices=merge, Closed=False)
pline_2 = PolyLine(Vertices=merge_2, Closed=False)
pline_3 = PolyLine(Vertices=merge_3, Closed=False)
pline_4 = PolyLine(Vertices=merge_4, Closed=False)
crv = Curve(pline_4)
crv_2 = Curve(pline)
crv_3 = Curve(pline_2)
crv_4 = Curve(pline_3)
merge_5 = Merge(Data1=crv_2, Data2=crv_4, Data3=crv, Data4=crv_3)
loft = Loft(Curves=merge_5, Options={Adjust=False, Closed=False, LoftEnds=0, LoftSimp=0, LoftType=0, Rebuild=10, Refit=0.01})
geo_6 = Geometry(loft)
xz = XZPlane(Origin=Point(0, 0, 0))
Y = UnitY(Factor=1)
number_slider = Slider(30, range=0..100)
contour = Contour(Shape=geo_6, Point=xz, Direction=Y, Distance=Slider(8, range=0..100))  # -> flatten(Contours)
offset = OffsetCurve(Curve=contour, Distance=Slider(2, range=0..10), Corners=1)  # -> flatten(Curve)
item = ListItem(List=contour, Index=Slider(19, range=0..100), Wrap=True)
item_2 = ListItem(List=contour, Index=0, Wrap=True)
edgesrf = EdgeSurface(CurveA=contour, CurveB=offset)
flip = FlipCurve(Curve=item)  # -> Curve, Flag
flip_2 = FlipCurve(Curve=item_2)  # -> Curve, Flag
Y_2 = UnitY(Factor=Slider(4, range=0..10))
extr = Extrude(Base=edgesrf, Direction=Y_2)
eval = EvaluateLength(Curve=flip.Curve, Length=number_slider, Normalized=invert(True))  # -> Point, Tangent, Parameter
eval_2 = EvaluateLength(Curve=flip_2.Curve, Length=number_slider, Normalized=invert(True))  # -> Point, Tangent, Parameter
geo_7 = Geometry(extr)
X = UnitX(Factor=Slider(36, range=0..100))
X_2 = UnitX(Factor=Slider(4, range=0..100))
move_16 = Move(Geometry=eval_2.Point, Motion=X)  # -> Geometry, Transform
move_17 = Move(Geometry=eval.Point, Motion=X_2)  # -> Geometry, Transform
ln = Line(StartPoint=eval_2.Point, EndPoint=eval.Point)
ln_2 = Line(StartPoint=move_16.Geometry, EndPoint=move_17.Geometry)
Z = UnitZ(Factor=Slider(4, range=0..10))
geo_8 = Geometry(geo_7)
neg_9 = Negative(Value=Z)
edgesrf_2 = EdgeSurface(CurveA=ln, CurveB=ln_2)
geo_9 = Geometry(<brep referenced from the Rhino model>)
extr_2 = Extrude(Base=edgesrf_2, Direction=neg_9)
sdiff = SolidDifference(BrepsA=flatten(geo_8), BrepsB=geo_9)
geo_10 = Geometry(sdiff)
geo_11 = Geometry(extr_2)
